# Grasshopper definition from_building_solids.gh (Grasshopper 1.0.7)

# ----
# Full Bldg Small Office ProgramType
panel = Panel("""2013::LargeOffice::ClosedOffice
2013::LargeOffice::Conference
2013::LargeOffice::Corridor
2013::LargeOffice::OpenOffice
2013::LargeOffice::Restroom
2013::LargeOffice::Storage""")
panel_2 = Panel("""0.15
0.15
0.2
0.4
0.05
0.05""")
blendprograms = HBBlendProgramTypes(name="LargeOfficeBuilding", programs=panel, ratios=panel_2)  # -> program; plug-in component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

# ----
# Construction Set
bldg_vintage = Dragonfly_BldgAge({"ASHRAE 90.1 2013  |  IECC 2015": "2013", "ASHRAE 90.1 2010  |  IECC 2012": "2010", "ASHRAE 90.1 2007  |  IECC 2009": "2007", "ASHRAE 90.1 2004  |  IECC 2006": "2004", "1980-2004 (CBECS)": "1980_2004", "Pre-1980 (CBECS)": "pre_1980"}, selected="ASHRAE 90.1 2013  |  IECC 2015")
constr_type = Dragonfly_BldgAge({"SteelFramed", "WoodFramed", "Mass", "Metal Building"}, selected="SteelFramed")
climate_zone = Dragonfly_BldgAge({"1 - Very Hot": "1", "2 - Hot": "2", "3 - Warm": "3", "4 - Mixed": "4", "5 - Cool": "5", "6 - Cold": "6", "7 - Very Cold": "7", "8 - Subarctic": "8"}, selected="5 - Cool")
searchconstrset = HBSearchConstructionSets(climate_zone=climate_zone, vintage=bldg_vintage, constr_type=constr_type)  # -> constr_set; plug-in component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

officesolids = Geometry([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])
panel_3 = Panel("""1@5
2@4
@3""")
buildingsolid = DFBuildingFromSolid(
    bldg_geo=flatten(officesolids),
    floor_to_floor=panel_3,
    name="OfficeBldg",
    program=blendprograms,
    constr_set=searchconstrset,
    run=Toggle(True))  # -> report, buildings; plug-in component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
decnstrdf = DFDeconstructObject(df_obj=buildingsolid.buildings)  # -> stories, room2ds; plug-in component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

panel_4 = Panel("""@4
@3""")

residentialsolids = Geometry([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])
buildingsolid_2 = DFBuildingFromSolid(
    bldg_geo=flatten(residentialsolids),
    floor_to_floor=panel_4,
    name="ResidentialBldg",
    program="2013::MidriseApartment::Apartment",
    constr_set=searchconstrset,
    run=Toggle(True))  # -> report, buildings; plug-in component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
simpleratiopar = DFSimpleWindowRatioParameters(ratio="0.25")  # -> win_par; plug-in component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
applyfacadepar = DFApplyFacadeParameters(df_obj=flatten(buildingsolid_2.buildings), win_par=simpleratiopar)  # -> report, df_obj; plug-in component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

wires = BrepWireframe(Brep=residentialsolids, Density=-1)
wires_2 = BrepWireframe(Brep=officesolids, Density=-1)

# ---- group: properties for ground floor retail
item = ListItem(List=decnstrdf.stories, Index="0", Wrap=True)
reassignprop = DFReassignEnergyProperties(df_obj=item, program="2013::Retail::Retail")  # -> df_obj; plug-in component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
overhangpar = DFOverhangParameters(depth="4", angle="10")  # -> shd_par; plug-in component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
simpleratiopar_2 = DFSimpleWindowRatioParameters(ratio="0.65")  # -> win_par; plug-in component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
applyfacadepar_2 = DFApplyFacadeParameters(df_obj=reassignprop, win_par=simpleratiopar_2, shd_par=overhangpar)  # -> report, df_obj; plug-in component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

# ---- group: properties for above-ground office
cull_i = CullIndex(List=decnstrdf.stories, Indices="0", Wrap=True)
repeatingratiopar = DFRepeatingWindowRatioParameters(ratio="0.4", glz_height="2.5")  # -> win_par; plug-in component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
applyfacadepar_3 = DFApplyFacadeParameters(df_obj=cull_i, win_par=repeatingratiopar)  # -> report, df_obj; plug-in component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

# ----
txt = Text(buildingsolid.buildings)
split = TextSplit(Text=txt, Separators=":")
item_2 = ListItem(List=split, Index="-1", Wrap=True)  # -> simplify(Item)

stories = Data(simplify(applyfacadepar_3.df_obj))
stories_2 = Data(simplify(applyfacadepar_2.df_obj))
stories_3 = Data(simplify([stories, stories_2]))
buildingstories = DFBuildingFromStories(stories=stories_3, name=item_2, constr_set=searchconstrset)  # -> report, building; plug-in component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
commercialbldgs = Data(flatten(buildingstories.building))
all_buildings = Data(flatten([commercialbldgs, applyfacadepar.df_obj]))

contextshade = Geometry([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])
context = DFContextShade(geo=contextshade, name="ParkingStructure")  # -> report, context; plug-in component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
toggle = BooleanToggle(True)
model = DFModel(buildings=flatten(all_buildings), context=flatten(context.context), name="Mass Pike District", run=toggle)  # -> report, model; plug-in component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
tohoneybee = DFModelToHoneybee(model=model.model, use_multiplier=Toggle(True), shade_dist="50", run=toggle)  # -> report, hb_models; plug-in component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

separatemodel = DFSeparateModel(model=model.model)  # -> buildings, context; plug-in component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

item_3 = ListItem(List=tohoneybee.hb_models, Index=Slider(1, range=0..10), Wrap=True)
vizall = HBVizualizeAll(hb_obj=flatten(item_3))  # -> geo; plug-in component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

# ----
# Simulation Parameters
toggle_2 = BooleanToggle(True)
simoutput = HBSimulationOutput(zone_energy_use=toggle_2, summary_reports="AllSummary")  # -> report, sim_output; plug-in component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
shadowcalc = HBShadowCalculation(solar_dist="FullExteriorWithReflections")  # -> shadow_calc; plug-in component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
simpar = HBSimulationParameter(output=simoutput.sim_output, timestep=6, shadow_calc=shadowcalc)  # -> sim_par; plug-in component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

# ----
# Download EPW File
panel_5 = Panel("https://www.energyplus.net/weather-download/north_and_central_america_wmo_region_4/USA/MA/USA_MA_Boston-Logan.Intl.AP.725090_TMY3/all")
downloadweather = LadybugPlus_DownloadWeather(weather_URL=panel_5)  # -> epw_file, stat_file, ddy_file; plug-in component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

modeltoidf = HBModelToIDF(
    model=tohoneybee.hb_models,
    epw_file=downloadweather.epw_file,
    sim_par=simpar,
    folder="C:\Users\chris\honeybee\district_model",
    write=Toggle(False))  # -> report, idf, sql, eio, rdd, html; plug-in component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

panel_6 = Panel("C:\Users\chris\Documents\GitHub\dragonfly-grasshopper\dragonfly_grasshopper")
createuo = LBCreateUserObject(folder=panel_6, change_type="fix", export=Toggle(False))  # -> read_me; plug-in component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
